# Grasshopper definition TAG-IT.gh (Grasshopper 1.0.7)
# plug-ins: Rhino.Inside for Autodesk Revit, jSwan

author_s = Panel("Elton Gjata")
# Output
# For groups that bake geometry out to Rhino or export data to external programs
gh_version = Panel("1.0.0007")
# Good Practice
# Guidelines
# 1. Divide the script into the user interface and the back end.
# 
# 2. Build the script with small groups of nodes
# 
# 3. Groups should always have input/output
# 
# 4. Rename the input/output containers to the data they carry
# 
# 5. Color code groups according to the categories in the template
# DESCRIPTION:: facade schemes for 8th pine commercial scheme facade
search_tags = Panel("")
# Monitor
# Display data that is helpful in creating or running the script
# ADDITIONAL ASSETS REQUIRED:: Rhino File Location:
# Other Required Files:
required_plugins = Panel("i.e. Ladybug 0.9")
# Annotation
# For comments and explanation
# Work-In-Progress
# For portions of the script that are not yet completed or are not working as intended
notes_issues = Panel("")

# ----
# ######.### PROJECT NAME: Study Name
# Design
# Control
# For user input (such as sliders, numbers...)
# Input
# For user input (such as sliders, numbers...)
panel = Panel("For Back-End Functionality")

file_path = FilePath("C:\Users\gjatae\aectech-hackathon-2024-tag-it\annotations.json")
# 2 - LOAD JSON
file_path_2 = FilePath(file_path)

# ----
# 1 - FIND  CURRENT ACTIVE SHEET VIEW
active_graphical_view = ActiveGraphicalView()

sheet_identity = SheetIdentity(Sheet=active_graphical_view)  # -> Placeholder, SheetNumber, SheetName, SheetIssueDate, AppearsInSheetList
deserialize_json = DeserializeJson(JSON=file_path_2, OutputsLocked=False)  # -> SheetName, Annotations
deserialize_json_2 = DeserializeJson(JSON=deserialize_json.Annotations, OutputsLocked=False)  # -> Subtype, Content, Location
deserialize_json_3 = DeserializeJson(JSON=deserialize_json_2.Location, OutputsLocked=False)
concatenate = Concatenate(Fragment_A=sheet_identity.SheetNumber, Fragment_B=" ", A=sheet_identity.SheetName)
panel_2 = Panel(concatenate)
panel_3 = Panel(deserialize_json.SheetName)
list_item = ListItem(List=deserialize_json_3, Index=0, Wrap=True)  # -> Item, Item1

built_in_categories = BuiltInCategories("autodesk.revit.category.family:titleBlocks-1.0.0", LayoutLevel=2, SearchPattern="titleblock")
query_view_elements = QueryViewElements(View=active_graphical_view, Categories=built_in_categories)
inspect_element = InspectElement(Element=query_view_elements)  # -> OtherFilePath, GraphicsScale, IdentityDataApprovedBy, IdentityDataCheckedBy, IdentityDataDateTimeStamp, IdentityDataDesignedBy, IdentityDataDrawnBy, IdentityDataSheetHeight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
number = Number(inspect_element.IdentityDataSheetHeight)
number_2 = Number(inspect_element.IdentityDataSheetWidth)
domain = Domain(number)
domain_2 = Domain(number_2)
number_3 = Number(list_item.Item1)
number_4 = Number(list_item.Item)
subtraction = Subtraction(A=1, B=number_4)
remap_numbers = RemapNumbers(Value=number_3, Source=Domain(0, 1), Target=domain_2)  # -> Mapped, Clipped
remap_numbers_2 = RemapNumbers(Value=subtraction, Source=Domain(0, 1), Target=domain)  # -> Mapped, Clipped
construct_point = ConstructPoint(XCoordinate=remap_numbers.Mapped, YCoordinate=remap_numbers_2.Mapped, ZCoordinate=0)
path_mapper = PathMapper(construct_point, source="{A;B;C;D}", target="{A;B;C}")
average = Average(Input=path_mapper)
point = Point(average)

text = Text(graft(deserialize_json_2.Content))
panel_4 = Panel(text)
panel_5 = Panel(number_4)

# ----
# 4B - ADD ANGULAR DIMENSION
point_2 = Point()
curve = Curve()
point_3 = Point()
view = View(active_graphical_view)
merge = Merge(Data1=point_2, Data2=point_3)
add_angular_dimension = AddAngularDimension(View=view, References=merge, Arc=curve, TrackingMode=2)

view_2 = View(active_graphical_view)

# ----
# 4 - ADD CLOUD
geometry = Geometry(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)
view_3 = View(active_graphical_view)
boundary_surfaces = BoundarySurfaces(Edges=geometry)
stream_filter = StreamFilter(Gate=Toggle(False), Stream0=boundary_surfaces)
add_revision_cloud = AddRevisionCloud(View=view_3, Boundary=stream_filter, TrackingMode=2)

# ----
# 3 - ADD LINEWORK
boolean_toggle = BooleanToggle(False)
geometry_2 = Geometry(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)
view_4 = View(active_graphical_view)
stream_filter_2 = StreamFilter(Gate=boolean_toggle, Stream0=geometry_2)
add_detail_line = AddDetailLine(View=view_4, Curve=stream_filter_2, TrackingMode=1)

# ----
# 4A - ADD LINEAR DIMENSION
point_4 = Point()
point_5 = Point()
line = Line()
view_5 = View(active_graphical_view)
merge_2 = Merge(Data1=point_4, Data2=point_5)
add_linear_dimension = AddLinearDimension(View=view_5, References=merge_2, Line=line, TrackingMode=2)

# ----
# CREATE MARKUP TEXT ANNOTATION TYPE
panel_6 = Panel("Autodesk.Revit.DB.TextNoteType")
class_filter = ClassFilter(Classes=panel_6)
query_types = QueryTypes(Kind=3, Filter=class_filter)
value_picker = ValuePicker(query_types)
duplicate_type = DuplicateType(TypeName="MARKUP", Type=value_picker, TrackingMode=2)

# ---- group: TEXT
# 2 - ADD TEXT
text_2 = Text(text)
enable = BooleanToggle(False)
text_type = Type(duplicate_type)
point_6 = Point(point)
stream_filter_3 = StreamFilter(Gate=enable, Stream0=text_2)
add_text = AddText(View=view_2, Point=point_6, Content=stream_filter_3, Type=text_type, TrackingMode=1)

# ----
# CREATE MARKUPS LINE STYLE
built_in_categories_2 = BuiltInCategories("autodesk.revit.category.local:lines-1.0.0", LayoutLevel=2, SearchPattern="LINES")
add_subcategory = AddSubCategory(Parent=built_in_categories_2, Name="MARKUPS", TrackingMode=2)
category_style = CategoryStyle(Category=add_subcategory, LineColor=ColourSwatch(SwatchColor=RGB(255, 0, 0)))  # -> Category, LineWeight_projection, LineWeight_cut, LineColor, LinePattern_projection, Material

element_geometry = ElementGeometry(Elements=add_text)

# ----
# 2B - ADD TEXT ANNOTATION LEADERS
add_leader = BooleanToggle(False)
text_note = TextNote(add_text)
point_7 = Point()
point_8 = Point()
point_9 = Point()
annotation_leaders = AnnotationLeaders(Annotation=text_note, Leader=add_leader, ShoulderLocations=point_8, EndLocations=point_9, TextLocations=point_7)  # -> Annotation, Leader, ShoulderLocations, EndLocations, TextLocations; disabled

# ----
# OVERRIDE ELEMENT GRAPHICS IN VIEW
graphic_overrides = GraphicOverrides()  # -> Overrides, Halftone, ProjectionLinesPattern, ProjectionLinesColor, ProjectionLinesWeight, SurfacePatternsForegroundVisible, SurfacePatternsForegroundPattern, SurfacePatternsForegroundColor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
hide = BooleanToggle(False)
view_6 = View(active_graphical_view)
element = Element(add_linear_dimension)
element_graphic_overrides = ElementGraphicOverrides(View=view_6, Element=element, Hidden=hide, Overrides=graphic_overrides.Overrides)  # -> View, Element, Hidden, Overrides; disabled

query_line_styles = QueryLineStyles(Name="MARKUPS")

# ----
# 3B - CHANGE LINE STYLE
line_style = LineStyle(query_line_styles)
panel_7 = Panel(line_style)
curve_line_style = CurveLineStyle(Element=add_detail_line, LineStyle=line_style)  # -> Element, LineStyle
