# Grasshopper definition TAG-IT_Hack.gh (Grasshopper 1.0.7)
# plug-ins: Rhino.Inside for Autodesk Revit, jSwan, treesloth01, MetaHopper, Telepathy

dat_data = ColourSwatch(SwatchColor=RGBA(101, 34, 128, 150))
out_outputs = ColourSwatch(SwatchColor=RGBA(255, 144, 54, 150))
inp_inputs = ColourSwatch(SwatchColor=RGBA(255, 231, 54, 150))
geo_geometry = ColourSwatch(SwatchColor=RGBA(34, 128, 34, 150))
rvt_revit = ColourSwatch(SwatchColor=RGBA(34, 90, 128, 150))

# ---- group: Active Graphical View
active = ActiveView()

# ---- group: Packages
docinfo = DocumentInfo(AutoUpdate=invert(False), Recursive=invert(False))  # -> DocumentName, DocumentFilePath, Components, Params, _3rdPartyAssemblies
panel = Panel(docinfo._3rdPartyAssemblies)

# ----
panel_2 = Panel("ws://213.27.218.158:8000")
mobile = Panel("ws://172.20.10.5:8000")
txt = Text(mobile)
websocket_client_start = WebsocketClientStart(Address=txt, InitalMessage="Hello World", Reset=Button())
websocket_client_receiver = WebsocketClientReceiver(WebsocketObjects=websocket_client_start, AutoUpdate=True)  # -> Message, Status
deserialize_json = DeserializeJson(JSON=websocket_client_receiver.Message, OutputsLocked=False)  # -> SheetName, Annotations

identity = SheetIdentity(Sheet=active)  # -> SheetNumber, SheetName

# ----
# 1 - FIND  CURRENT ACTIVE SHEET VIEW
panel_3 = Panel(" ")
concatenate = Concatenate(Fragment_A=identity.SheetNumber, Fragment_B=panel_3, A=identity.SheetName)

# ----
# INPUT AND LISTENING
# 2 - LOAD JSON
revit_active_view = RemoteSender(active)

# ----
# CREATE MARKUP TEXT ANNOTATION TYPE
panel_4 = Panel("Autodesk.Revit.DB.TextNoteType")
class_filter = ClassFilter(Classes=panel_4)
types = QueryTypes(Kind=3, Filter=class_filter)
value_picker = ValuePicker(types)
duplicate = DuplicateType(TypeName="MARKUP", Type=value_picker, TrackingMode=2)

# ----
# CREATE MARKUPS LINE STYLE
built_in_categories = BuiltInCategories("autodesk.revit.category.local:lines-1.0.0", LayoutLevel=2, SearchPattern="LINES")
subcat = AddSubCategory(Parent=built_in_categories, Name="MARKUPS", TrackingMode=2)
catstyle = CategoryStyle(Category=subcat, LineColor=ColourSwatch(SwatchColor=RGB(255, 0, 0)))  # -> Category, LineWeight_projection, LineWeight_cut, LineColor, LinePattern_projection, Material

toggle = GroupToggle(ToggleActive=True, ToggleVisible=False)  # disabled
line_styles = QueryLineStyles(Name="MARKUPS")

# ----
# DATA MANIPULATION
# FILTER JSON
# REMAP JSON ELEMENTS COORDINATES
# GEOMETRY AND MARKUP TYPES
revit_active_view_2 = RemoteReceiver(revit_active_view)
tmatch = MatchText(Text=concatenate, Pattern=deserialize_json.SheetName, Case=True)
filter = StreamFilter(Gate=tmatch, Stream1=deserialize_json.Annotations)
deserialize_json_2 = DeserializeJson(JSON=filter, OutputsLocked=False)  # -> Date, Subtype, Author, Color, Bounding_box, Contents, Subject, Border_width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
entwine = Entwine(
    Branch0X=deserialize_json_2.Bounding_box,
    Branch1X=deserialize_json_2.Ink_list,
    Branch2X=deserialize_json_2.Vertices,
    Branch3X=deserialize_json_2.Location,
    FlattenInputs=False)
json_geometry = RemoteSender(entwine)
json_geometry_2 = RemoteReceiver(json_geometry)

flip = FlipMatrix(Data=deserialize_json_2.Contents)
cset = CreateSet(List=deserialize_json_2.Subtype)  # -> Set, Map
mindex = MemberIndex(Set=deserialize_json_2.Subtype, Member=cset.Set)  # -> Index, Count
rep = ReplaceText(Text="{*;x}", Find="x", Replace=mindex.Index, RecursiveReplace=False)
split = SplitTree(Data=flip, Masks=flatten(rep))  # -> Positive, Negative

mindex_2 = MemberIndex(Set=deserialize_json_2.Subtype, Member="/Polygon")  # -> Index, Count
rep_2 = ReplaceText(Text="{0;0;x}", Find="x", Replace=mindex_2.Index, RecursiveReplace=False)
rep_3 = ReplaceText(Text=rep_2, Find=";0;", Replace=";", RecursiveReplace=False)
split_2 = SplitTree(Data=flip, Masks=flatten(rep_3))  # -> Positive, Negative
tmatch_2 = MatchText(Text=split_2.Positive, Pattern="Cloud", Case=True)
clean = CleanTree(RemoveNulls=True, RemoveInvalid=True, RemoveEmpty=invert(False), Tree=tmatch_2)

# ----
# GET MARKUP TEXT
item = ListItem(List=split.Positive, Index=0, Wrap=True)
text = Text(item)

panel_5 = Panel(text)

built_in_categories_2 = BuiltInCategories("autodesk.revit.category.family:titleBlocks-1.0.0", LayoutLevel=2, SearchPattern="titleblock")

# ---- group: Query View Elements
g_elements = QueryGraphicalElements(View=revit_active_view_2, Categories=built_in_categories_2)

# ----
inspect_element = InspectElement(Element=g_elements)  # -> IdentityDataSheetHeight, IdentityDataSheetWidth

deserialize_json_3 = DeserializeJson(JSON=json_geometry_2, OutputsLocked=False)
clean_2 = CleanTree(RemoveNulls=True, RemoveInvalid=True, RemoveEmpty=invert(False), Tree=deserialize_json_3)
list_item = ListItem(List=clean_2, Index=0, Wrap=True)  # -> Item, Item1
number = Number(inspect_element.IdentityDataSheetHeight)
number_2 = Number(inspect_element.IdentityDataSheetWidth)
number_3 = Number(list_item.Item)
number_4 = Number(list_item.Item1)
domain = Domain(number_2)
domain_2 = Domain(number)
subtraction = Subtraction(A=1, B=number_3)
remap_numbers = RemapNumbers(Value=subtraction, Source=Domain(0, 1), Target=domain_2)  # -> Mapped, Clipped
remap_numbers_2 = RemapNumbers(Value=number_4, Source=Domain(0, 1), Target=domain)  # -> Mapped, Clipped
construct_point = ConstructPoint(XCoordinate=remap_numbers_2.Mapped, YCoordinate=remap_numbers.Mapped, ZCoordinate=0)
path_mapper = PathMapper(construct_point, source="{A;B;C;D;E}", target="{A;B;C;D}")

panel_6 = Panel("""0
1
2
3""")
rep_4 = ReplaceText(Text="{x;*}", Find="x", Replace=graft(panel_6), RecursiveReplace=False)
bang = ExplodeTree(Data=rep_4)  # -> Branch0, Branch1, Branch2, Branch3
split_3 = SplitTree(Data=path_mapper, Masks=bang.Branch0)  # -> Positive, Negative
split_4 = SplitTree(Data=split_3.Negative, Masks=bang.Branch1)  # -> Positive, Negative
split_5 = SplitTree(Data=split_4.Negative, Masks=bang.Branch2)  # -> Positive, Negative

path_mapper_2 = PathMapper(split_5.Positive, source="{A;B;C;D}", target="{B;C;D}")
split_6 = SplitTree(Data=path_mapper_2, Masks=flatten(rep_2))  # -> Positive, Negative
bool = Boolean(True)
intcrv = Interpolate(Vertices=split_6.Negative, Degree="1", Periodic=invert(bool), KnotStyle=1)  # -> Curve, Length, Domain
intcrv_2 = Interpolate(Vertices=split_6.Positive, Degree="1", Periodic=bool, KnotStyle=1)  # -> Curve, Length, Domain
dispatch = Dispatch(List=intcrv_2.Curve, DispatchPattern=clean)  # -> ListA, ListB
clean_3 = CleanTree(RemoveNulls=True, RemoveInvalid=True, RemoveEmpty=invert(False), Tree=dispatch.ListB)
clean_4 = CleanTree(RemoveNulls=True, RemoveInvalid=True, RemoveEmpty=invert(False), Tree=dispatch.ListA)

bool_2 = Boolean(False)
intcrv_3 = Interpolate(Vertices=split_4.Positive, Degree="1", Periodic=bool_2, KnotStyle=1)  # -> Curve, Length, Domain

item_2 = ListItem(List=split_5.Negative, Index=0, Wrap=True)  # -> Item, Item1
ln = Line(StartPoint=item_2.Item, EndPoint=item_2.Item1)
line = Line(ln)

average = Average(Input=split_3.Positive)
point = Point(average)

text_values = RemoteSender(text)
text_points = RemoteSender(point)
merge = Merge(Data1=intcrv_3.Curve, Data2=clean_3, Data3=intcrv.Curve, Data4=line)
geo = Geometry(clean_4)
line_locations = RemoteSender(merge)
cloud_boundary = RemoteSender(geo)

# ----
# EXPORT TO REVIT
revit_active_view_3 = RemoteReceiver(revit_active_view)
text_points_2 = RemoteReceiver(text_points)
text_values_2 = RemoteReceiver(text_values)
revit_active_view_4 = RemoteReceiver(revit_active_view)
line_locations_2 = RemoteReceiver(line_locations)
revit_active_view_5 = RemoteReceiver(revit_active_view)
revit_active_view_6 = RemoteReceiver(revit_active_view)
cloud_boundary_2 = RemoteReceiver(cloud_boundary)
view = View(revit_active_view_3)

tmatch_3 = MatchText(Text=text_values_2, Pattern="null", Case=True)
flatten = FlattenTree(Tree=tmatch_3, Path="{0}")
bool_3 = Boolean(invert(flatten))
cull_multiple = CullMultiple(L0=flatten(text_values_2), L1=flatten(text_points_2), P=bool_3)  # -> graft(L0), graft(L1)

# ---- group: OU
# DIMENSIONS NEEDS TO BE ATTACHED TO REVIT ELEMENTS
pt = Point()  # disabled
pt_2 = Point()  # disabled
bool_4 = Boolean(bool_3)  # disabled
line_2 = Line()  # disabled
revit_active_view_7 = RemoteReceiver(revit_active_view)  # disabled
cull_multiple_2 = CullMultiple(L0=flatten(pt), L1=flatten(pt_2), P=bool_4)  # -> graft(L0), graft(L1); disabled
dispatch_2 = Dispatch(List=flatten(line_2), DispatchPattern=bool_4)  # -> graft(ListA), graft(ListB); disabled

# ----
# 3 - ADD LINEWORK
boolean_toggle = BooleanToggle(True)
explode = Explode(Curve=line_locations_2, Recursive=True)  # -> Segments, Vertices
view_2 = View(revit_active_view_4)
line_3 = Line(explode.Segments)
stream_filter = StreamFilter(Gate=boolean_toggle, Stream1=line_3)
d_line = AddDetailLine(View=view_2, Curve=stream_filter, TrackingMode=1)

# ----
# 4B - ADD ANGULAR DIMENSION
point_2 = Point()  # disabled
curve = Curve()  # disabled
view_3 = View(revit_active_view_6)
point_3 = Point()  # disabled
merge_2 = Merge(Data1=point_2, Data2=point_3)
a_dim = AddAngularDimension(View=view_3, References=merge_2, Arc=curve, TrackingMode=2)

# ----
# 4 - ADD CLOUD
boolean_toggle_2 = BooleanToggle(True)
view_4 = View(revit_active_view_5)
stream_filter_2 = StreamFilter(Gate=boolean_toggle_2, Stream1=cloud_boundary_2)
r_cloud = AddRevisionCloud(View=view_4, Boundary=stream_filter_2, TrackingMode=2)

# ----
# 2 - ADD TEXT
enable = BooleanToggle(True)
text_2 = Text(cull_multiple.L0)
point_4 = Point(cull_multiple.L1)
stream_filter_3 = StreamFilter(Gate=enable, Stream1=text_2)
text_type = Type(duplicate)
text_3 = AddText(View=view, Point=point_4, Content=stream_filter_3, Type=text_type, TrackingMode=1)

# ----
# 3B - CHANGE LINE STYLE
line_style = LineStyle(line_styles)
panel_7 = Panel(line_style)
linestyle = CurveLineStyle(Element=d_line, LineStyle=line_style)  # -> Element, LineStyle

# ----
# 2B - ADD TEXT ANNOTATION LEADERS
add_leader = BooleanToggle(False)
text_note = TextNote(text_3)
point_5 = Point()
point_6 = Point()
point_7 = Point()
leaders = AnnotationLeaders(Annotation=text_note, Leader=add_leader, ShoulderLocations=point_7, EndLocations=point_5, TextLocations=point_6)  # -> Annotation, Leader, ShoulderLocations, EndLocations, TextLocations; disabled

# ---- group: OU
toggle_2 = GroupToggle(ToggleActive=True, ToggleVisible=False)  # disabled
pt_3 = Point(cull_multiple_2.L1)  # disabled
pt_4 = Point(cull_multiple_2.L0)  # disabled
line_4 = Line(dispatch_2.ListA)  # disabled
boolean_toggle_3 = BooleanToggle(False)  # disabled

# 4A - ADD LINEAR DIMENSION
view_5 = View(revit_active_view_7)  # disabled
merge_3 = Merge(Data1=pt_4, Data2=pt_3)  # disabled

stream_filter_4 = StreamFilter(Gate=boolean_toggle_3, Stream1=view_5)  # disabled

l_dim = AddLinearDimension(View=stream_filter_4, Line=line_4, TrackingMode=2)  # disabled

# OVERRIDE ELEMENT GRAPHICS IN VIEW
hide = BooleanToggle(False)  # disabled
g_overrides = GraphicOverrides()  # disabled
view_6 = View(revit_active_view_7)  # disabled
element = Element(l_dim)  # disabled
eg_overrides = ElementGraphicOverrides(View=view_6, Element=element, Hidden=hide, Overrides=g_overrides)  # -> View, Element, Hidden, Overrides; disabled
